# Dynamo graph Dashboard.dyn (Dynamo 1.3.0.875)

# group: DOORS
file_path = Filename("C:\Revit data\Raw data.xlsx")
code_block = CodeBlock { "Door Numbers"; 0; }
categories = Categories("Doors")
all_elements_of_category = ElementsOfCategory(categories)
watch = Watch(all_elements_of_category)
code_block_2 = CodeBlock()
# ---------- code_block_2.designscript (21 lines) ----------
"Aluminium";
"Timber Hollow Core";
"HSC";
"Timber Solid Core";
"FD -/n/n";
"SD -/-/-SM";
"DG";
"Undercut";
"VP";
"FVP";
"Kickplate";
"Latch Set";
"Lock Set";
"Vestibule Lock";
"Push Plate/Pull Handle";
"Auto Sliding System";
"Auto Opening System";
"Privacy Lock";
"Fixed Handles";
"Family";
"Mark";
# ----------------------------------------
getParameterValueByName = Element.GetParameterValueByName(element=watch, parameterName=code_block_2.out0)
code_block_3 = CodeBlock { "√"; "-"; }
if_ = If(test=getParameterValueByName, true=code_block_3.out0, false=code_block_3.out1)
getParameterValueByName_2 = Element.GetParameterValueByName(element=watch, parameterName=code_block_2.out1)
code_block_4 = CodeBlock { "√"; "-"; }
if_2 = If(test=getParameterValueByName_2, true=code_block_4.out0, false=code_block_4.out1)
getParameterValueByName_3 = Element.GetParameterValueByName(element=watch, parameterName=code_block_2.out2)
code_block_5 = CodeBlock { "√"; "-"; }
if_3 = If(test=getParameterValueByName_3, true=code_block_5.out0, false=code_block_5.out1)
getParameterValueByName_4 = Element.GetParameterValueByName(element=watch, parameterName=code_block_2.out3)
code_block_6 = CodeBlock { "√"; "-"; }
if_4 = If(test=getParameterValueByName_4, true=code_block_6.out0, false=code_block_6.out1)
getParameterValueByName_5 = Element.GetParameterValueByName(element=watch, parameterName=code_block_2.out4)
code_block_7 = CodeBlock { "√"; "-"; }
if_5 = If(test=getParameterValueByName_5, true=code_block_7.out0, false=code_block_7.out1)
getParameterValueByName_6 = Element.GetParameterValueByName(element=watch, parameterName=code_block_2.out5)
code_block_8 = CodeBlock { "√"; "-"; }
if_6 = If(test=getParameterValueByName_6, true=code_block_8.out0, false=code_block_8.out1)
getParameterValueByName_7 = Element.GetParameterValueByName(element=watch, parameterName=code_block_2.out6)
code_block_9 = CodeBlock { "√"; "-"; }
if_7 = If(test=getParameterValueByName_7, true=code_block_9.out0, false=code_block_9.out1)
getParameterValueByName_8 = Element.GetParameterValueByName(element=watch, parameterName=code_block_2.out7)
code_block_10 = CodeBlock { "√"; "-"; }
if_8 = If(test=getParameterValueByName_8, true=code_block_10.out0, false=code_block_10.out1)
getParameterValueByName_9 = Element.GetParameterValueByName(element=watch, parameterName=code_block_2.out8)
code_block_11 = CodeBlock { "√"; "-"; }
if_9 = If(test=getParameterValueByName_9, true=code_block_11.out0, false=code_block_11.out1)
getParameterValueByName_10 = Element.GetParameterValueByName(element=watch, parameterName=code_block_2.out9)
code_block_12 = CodeBlock { "√"; "-"; }
if_10 = If(test=getParameterValueByName_10, true=code_block_12.out0, false=code_block_12.out1)
getParameterValueByName_11 = Element.GetParameterValueByName(element=watch, parameterName=code_block_2.out10)
code_block_13 = CodeBlock { "√"; "-"; }
if_11 = If(test=getParameterValueByName_11, true=code_block_13.out0, false=code_block_13.out1)
getParameterValueByName_12 = Element.GetParameterValueByName(element=watch, parameterName=code_block_2.out11)
code_block_14 = CodeBlock { "√"; "-"; }
if_12 = If(test=getParameterValueByName_12, true=code_block_14.out0, false=code_block_14.out1)
getParameterValueByName_13 = Element.GetParameterValueByName(element=watch, parameterName=code_block_2.out12)
code_block_15 = CodeBlock { "√"; "-"; }
if_13 = If(test=getParameterValueByName_13, true=code_block_15.out0, false=code_block_15.out1)
getParameterValueByName_14 = Element.GetParameterValueByName(element=watch, parameterName=code_block_2.out13)
code_block_16 = CodeBlock { "√"; "-"; }
if_14 = If(test=getParameterValueByName_14, true=code_block_16.out0, false=code_block_16.out1)
getParameterValueByName_15 = Element.GetParameterValueByName(element=watch, parameterName=code_block_2.out14)
code_block_17 = CodeBlock { "√"; "-"; }
if_15 = If(test=getParameterValueByName_15, true=code_block_17.out0, false=code_block_17.out1)
getParameterValueByName_16 = Element.GetParameterValueByName(element=watch, parameterName=code_block_2.out15)
code_block_18 = CodeBlock { "√"; "-"; }
if_16 = If(test=getParameterValueByName_16, true=code_block_18.out0, false=code_block_18.out1)
getParameterValueByName_17 = Element.GetParameterValueByName(element=watch, parameterName=code_block_2.out16)
code_block_19 = CodeBlock { "√"; "-"; }
if_17 = If(test=getParameterValueByName_17, true=code_block_19.out0, false=code_block_19.out1)
getParameterValueByName_18 = Element.GetParameterValueByName(element=watch, parameterName=code_block_2.out17)
code_block_20 = CodeBlock { "√"; "-"; }
if_18 = If(test=getParameterValueByName_18, true=code_block_20.out0, false=code_block_20.out1)
getParameterValueByName_19 = Element.GetParameterValueByName(element=watch, parameterName=code_block_2.out18)
code_block_21 = CodeBlock { "√"; "-"; }
if_19 = If(test=getParameterValueByName_19, true=code_block_21.out0, false=code_block_21.out1)
getParameterValueByName_20 = Element.GetParameterValueByName(element=watch, parameterName=code_block_2.out19)
getParameterValueByName_21 = Element.GetParameterValueByName(element=watch, parameterName=code_block_2.out20)
create = List.Create(if_, if_2, if_3, if_4, if_5, if_6, if_7, if_8, if_9, if_10, if_11, if_12, if_13, if_14, if_15, if_16, if_17, if_18, if_19, getParameterValueByName_20, getParameterValueByName_21)
transpose = List.Transpose(create)
watch_2 = Watch(transpose)
boolean = BoolSelector(true)
writeToFile = Excel.WriteToFile(filePath=file_path, sheetName=code_block.out0, startRow=code_block.out1, startCol=code_block.out1, data=watch_2, overWrite=boolean)
parameters = Element.Parameters(all_elements_of_category)
watch_3 = Watch(parameters)

# group: WINDOWS
categories_2 = Categories("Windows")
all_elements_of_category_2 = ElementsOfCategory(categories_2)
parameters_2 = Element.Parameters(all_elements_of_category_2)
watch_4 = Watch(parameters_2)
file_path_2 = Filename("C:\Revit data\Raw data.xlsx")
code_block_22 = CodeBlock { "Window Numbers"; 0; }
watch_5 = Watch(all_elements_of_category_2)
code_block_23 = CodeBlock()
# ---------- code_block_23.designscript (19 lines) ----------
"TG";
"OG";
"FG";
"FD -/-/-";
"SD -/-/-SM";
"Double Glazing";
"Single Glazing";
"40 Series";
"100 Series";
"150 Series";
"Flush Glazed";
"Shop Front";
"Low E";
"Opening Sashes";
"Latch Set";
"Lock Set";
"Manifestations";
"Family";
"Mark";
# ----------------------------------------
getParameterValueByName_22 = Element.GetParameterValueByName(element=watch_5, parameterName=code_block_23.out0)
code_block_24 = CodeBlock { "√"; "-"; }
if_20 = If(test=getParameterValueByName_22, true=code_block_24.out0, false=code_block_24.out1)
getParameterValueByName_23 = Element.GetParameterValueByName(element=watch_5, parameterName=code_block_23.out1)
code_block_25 = CodeBlock { "√"; "-"; }
if_21 = If(test=getParameterValueByName_23, true=code_block_25.out0, false=code_block_25.out1)
getParameterValueByName_24 = Element.GetParameterValueByName(element=watch_5, parameterName=code_block_23.out2)
code_block_26 = CodeBlock { "√"; "-"; }
if_22 = If(test=getParameterValueByName_24, true=code_block_26.out0, false=code_block_26.out1)
getParameterValueByName_25 = Element.GetParameterValueByName(element=watch_5, parameterName=code_block_23.out3)
code_block_27 = CodeBlock { "√"; "-"; }
if_23 = If(test=getParameterValueByName_25, true=code_block_27.out0, false=code_block_27.out1)
getParameterValueByName_26 = Element.GetParameterValueByName(element=watch_5, parameterName=code_block_23.out4)
code_block_28 = CodeBlock { "√"; "-"; }
if_24 = If(test=getParameterValueByName_26, true=code_block_28.out0, false=code_block_28.out1)
getParameterValueByName_27 = Element.GetParameterValueByName(element=watch_5, parameterName=code_block_23.out5)
code_block_29 = CodeBlock { "√"; "-"; }
if_25 = If(test=getParameterValueByName_27, true=code_block_29.out0, false=code_block_29.out1)
getParameterValueByName_28 = Element.GetParameterValueByName(element=watch_5, parameterName=code_block_23.out6)
code_block_30 = CodeBlock { "√"; "-"; }
if_26 = If(test=getParameterValueByName_28, true=code_block_30.out0, false=code_block_30.out1)
getParameterValueByName_29 = Element.GetParameterValueByName(element=watch_5, parameterName=code_block_23.out7)
code_block_31 = CodeBlock { "√"; "-"; }
if_27 = If(test=getParameterValueByName_29, true=code_block_31.out0, false=code_block_31.out1)
getParameterValueByName_30 = Element.GetParameterValueByName(element=watch_5, parameterName=code_block_23.out8)
code_block_32 = CodeBlock { "√"; "-"; }
if_28 = If(test=getParameterValueByName_30, true=code_block_32.out0, false=code_block_32.out1)
getParameterValueByName_31 = Element.GetParameterValueByName(element=watch_5, parameterName=code_block_23.out9)
code_block_33 = CodeBlock { "√"; "-"; }
if_29 = If(test=getParameterValueByName_31, true=code_block_33.out0, false=code_block_33.out1)
getParameterValueByName_32 = Element.GetParameterValueByName(element=watch_5, parameterName=code_block_23.out10)
code_block_34 = CodeBlock { "√"; "-"; }
if_30 = If(test=getParameterValueByName_32, true=code_block_34.out0, false=code_block_34.out1)
getParameterValueByName_33 = Element.GetParameterValueByName(element=watch_5, parameterName=code_block_23.out11)
code_block_35 = CodeBlock { "√"; "-"; }
if_31 = If(test=getParameterValueByName_33, true=code_block_35.out0, false=code_block_35.out1)
getParameterValueByName_34 = Element.GetParameterValueByName(element=watch_5, parameterName=code_block_23.out12)
code_block_36 = CodeBlock { "√"; "-"; }
if_32 = If(test=getParameterValueByName_34, true=code_block_36.out0, false=code_block_36.out1)
getParameterValueByName_35 = Element.GetParameterValueByName(element=watch_5, parameterName=code_block_23.out13)
code_block_37 = CodeBlock { "√"; "-"; }
if_33 = If(test=getParameterValueByName_35, true=code_block_37.out0, false=code_block_37.out1)
getParameterValueByName_36 = Element.GetParameterValueByName(element=watch_5, parameterName=code_block_23.out14)
code_block_38 = CodeBlock { "√"; "-"; }
if_34 = If(test=getParameterValueByName_36, true=code_block_38.out0, false=code_block_38.out1)
getParameterValueByName_37 = Element.GetParameterValueByName(element=watch_5, parameterName=code_block_23.out15)
code_block_39 = CodeBlock { "√"; "-"; }
if_35 = If(test=getParameterValueByName_37, true=code_block_39.out0, false=code_block_39.out1)
getParameterValueByName_38 = Element.GetParameterValueByName(element=watch_5, parameterName=code_block_23.out16)
code_block_40 = CodeBlock { "√"; "-"; }
if_36 = If(test=getParameterValueByName_38, true=code_block_40.out0, false=code_block_40.out1)
getParameterValueByName_39 = Element.GetParameterValueByName(element=watch_5, parameterName=code_block_23.out17)
getParameterValueByName_40 = Element.GetParameterValueByName(element=watch_5, parameterName=code_block_23.out18)
create_2 = List.Create(if_20, if_21, if_22, if_23, if_24, if_25, if_26, if_27, if_28, if_29, if_30, if_31, if_32, if_33, if_34, if_35, if_36, getParameterValueByName_39, getParameterValueByName_40)
transpose_2 = List.Transpose(create_2)
watch_6 = Watch(transpose_2)
boolean_2 = BoolSelector(true)
writeToFile_2 = Excel.WriteToFile(filePath=file_path_2, sheetName=code_block_22.out0, startRow=code_block_22.out1, startCol=code_block_22.out1, data=watch_6, overWrite=boolean_2)

# group: SHEETS
categories_3 = Categories("Sheets")
all_elements_of_category_3 = ElementsOfCategory(categories_3)
parameters_3 = Element.Parameters(all_elements_of_category_3)
watch_7 = Watch(parameters_3)
categories_4 = Categories("Sheets")
all_elements_of_category_4 = ElementsOfCategory(categories_4)
parameters_4 = Element.Parameters(all_elements_of_category_4)
watch_8 = Watch(parameters_4)
file_path_3 = Filename("C:\Revit data\Raw data.xlsx")
code_block_41 = CodeBlock { "Sheets"; 0; }
watch_9 = Watch(all_elements_of_category_4)
code_block_42 = CodeBlock { "Sheet Number"; "Sheet Name"; "Current Revision"; }
getParameterValueByName_41 = Element.GetParameterValueByName(element=watch_9, parameterName=code_block_42.out0)
getParameterValueByName_42 = Element.GetParameterValueByName(element=watch_9, parameterName=code_block_42.out1)
watch_10 = Watch(all_elements_of_category_3)
code_block_43 = CodeBlock { "Sheet Number"; "Sheet Name"; "Current Revision"; }
getParameterValueByName_43 = Element.GetParameterValueByName(element=watch_10, parameterName=code_block_43.out2)
code_block_44 = CodeBlock { "-"; }
if_37 = If(test=getParameterValueByName_43, true=getParameterValueByName_43, false=code_block_44)
create_3 = List.Create(getParameterValueByName_41, getParameterValueByName_42, if_37)
transpose_3 = List.Transpose(create_3)
watch_11 = Watch(transpose_3)
boolean_3 = BoolSelector(true)
writeToFile_3 = Excel.WriteToFile(filePath=file_path_3, sheetName=code_block_41.out0, startRow=code_block_41.out1, startCol=code_block_41.out1, data=watch_11, overWrite=boolean_3)
file_path_4 = Filename("C:\Revit data\Raw data.xlsx")
code_block_45 = CodeBlock { "Sheets"; 0; }
getParameterValueByName_44 = Element.GetParameterValueByName(element=watch_10, parameterName=code_block_43.out0)
getParameterValueByName_45 = Element.GetParameterValueByName(element=watch_10, parameterName=code_block_43.out1)
create_4 = List.Create(getParameterValueByName_44, getParameterValueByName_45, if_37)
transpose_4 = List.Transpose(create_4)
watch_12 = Watch(transpose_4)
boolean_4 = BoolSelector(true)
writeToFile_4 = Excel.WriteToFile(filePath=file_path_4, sheetName=code_block_45.out0, startRow=code_block_45.out1, startCol=code_block_45.out1, data=watch_12, overWrite=boolean_4)

# group: PROJECT INFORMATION
file_path_5 = Filename("C:\Revit data\Raw data.xlsx")
code_block_46 = CodeBlock { "Project Info"; 0; }
code_block_47 = CodeBlock { "PivotTable head"; }
categories_5 = Categories("ProjectInformation")
all_elements_of_category_5 = ElementsOfCategory(categories_5)
code_block_48 = CodeBlock { "Project Number"; "Project Name"; }
getParameterValueByName_46 = Element.GetParameterValueByName(element=all_elements_of_category_5, parameterName=code_block_48.out0)
getParameterValueByName_47 = Element.GetParameterValueByName(element=all_elements_of_category_5, parameterName=code_block_48.out1)
create_5 = List.Create(getParameterValueByName_46, getParameterValueByName_47)
transpose_5 = List.Transpose(create_5)
addItemToFront = List.AddItemToFront(item=code_block_47, list=transpose_5)
boolean_5 = BoolSelector(true)
writeToFile_5 = Excel.WriteToFile(filePath=file_path_5, sheetName=code_block_46.out0, startRow=code_block_46.out1, startCol=code_block_46.out1, data=addItemToFront, overWrite=boolean_5)
