# Dynamo graph FilledregionParameterLength.dyn (Dynamo 1.3.0.875)

select_face = DSFaceSelection()
perimeterCurves = Surface.PerimeterCurves(select_face)
length = Curve.Length(perimeterCurves)
sum = Math.Sum(length)
