# Dynamo graph RevitUpgrade.dyn (Dynamo 1.3.1.1736)

code_block = CodeBlock { true; }

# group: Rhythm
backgroundOpen = Custom[Document.BackgroundOpen]()  # This will open the input Revit files in the background.; unwired: filePath
close = Custom[Document.Close](document=backgroundOpen, save=code_block)  # This will close the input Revit document. Offers a boolean toggle to save.

# group: input
# note: The following Dynamo bulk family upgrade process was published by John Pierson http://sixtysecondrevit.com/2016-10-26-bulk-upgrade-revit-files-with-dynamobim/
# Only changes were adding the Directory.FromPath and renaming graph so you know what version of Dynamo was used as well as grouping the custom package nodes.
directory_path = Directory("No file selected.")

fromPath = DirectoryObject(directory_path)  # "Directory.FromPath"
contents = Directory.Contents(fromPath)
openDocumentFile = RevitElements.Application.OpenDocumentFile(contents)
upgradeFamilies = Tools.Batch.UpgradeFamilies()  # unwired: arg0
