# Dynamo graph ViewFilter.dyn (Dynamo 1.3.0.875)

view_templates = ViewTemplatesUI("EGM_CD_Plan_Template_1-100")
filters = View.Filters(view_templates)
filterOverrides = View.FilterOverrides(view_templates, filters)
boolean = BoolSelector(true)
setFilterOverrides = View.SetFilterOverrides(hide=boolean)  # unwired: view, parameterFilter, overrides
view_templates_2 = ViewTemplatesUI("Tempate_Dummy")
removeFilter = Archilab.Grimshaw.Views.View.RemoveFilter()  # unwired: arg0, arg1

# group: RETRIEVING ALL VIEW TEMPLATES FROM PROJECT
allViewTemplates_EGM = Custom[AllViewTemplates_EGM]()  # List of all existing view templates
lengthViewTemplates = Custom[LengthViewTemplates]()  # The number of existing view templates
boolean_2 = BoolSelector(true)
passingViews = Python(IN[0]=lengthViewTemplates, IN[1]=boolean_2)
# ---------- passingViews.python (11 lines) ----------
import time

if IN[1] == True:
	lst = []
	for i in range(0,IN[0]):
		lst.append(i)
		time.sleep(0.1)
else:
	pass

OUT = lst
# ----------------------------------------
getItemAtIndex = List.GetItemAtIndex(list=allViewTemplates_EGM, index=passingViews)
