# Dynamo graph ViewFilterAdd.dyn (Dynamo 1.3.0.875)

# group: Target View Template for a filter to be applied
view_templates = ViewTemplatesUI("EGM_DD_Plan_Template_1-100")

# group: View Template for a filter to be copied from
view_templates_2 = ViewTemplatesUI("Tempate_Dummy")
filters = View.Filters(view_templates_2)
filterOverrides = View.FilterOverrides(view_templates_2, filters)

boolean = BoolSelector(true)
setFilterOverrides = View.SetFilterOverrides(view=view_templates, parameterFilter=filters, overrides=filterOverrides, hide=boolean)
