# Dynamo graph ViewFilterControl.dyn (Dynamo 1.3.0.875)

view_templates = ViewTemplatesUI("EGM_DD_Plan_Template_1-100")

# group: View Template for a filter to be copied
view_templates_2 = ViewTemplatesUI("Tempate_Dummy")
filters = View.Filters(view_templates_2)
filterOverrides = View.FilterOverrides(view_templates_2, filters)

boolean = BoolSelector(true)
setFilterOverrides = View.SetFilterOverrides(view=view_templates, parameterFilter=filters, overrides=filterOverrides, hide=boolean)
removeFilter = Archilab.Grimshaw.Views.View.RemoveFilter()  # unwired: arg0, arg1
