# Dynamo graph ViewFilterRemove.dyn (Dynamo 1.3.0.875)

# group: Target View Template for filters to be removed from
view_templates = ViewTemplatesUI("EGM_DD_Plan_Template_1-100")

# group: Filters to remove
view_templates_2 = ViewTemplatesUI("Tempate_Dummy")
filters = View.Filters(view_templates_2)

removeFilter = Archilab.Grimshaw.Views.View.RemoveFilter(view_templates, filters)
