# Dynamo graph Window number changer.dyn (Dynamo 1.3.0.875)

# group: WINDOW NUMBER CHANGER
file_path = Filename("..\..\..\..\..\Revit data\Data to Revit.xlsm")
code_block = CodeBlock { "Window Number Changer"; 0; }
categories = Categories("Windows")
all_elements_of_category = ElementsOfCategory(categories)
watch = Watch(all_elements_of_category)
code_block_2 = CodeBlock { "Family"; "Mark"; }
getParameterValueByName = Element.GetParameterValueByName(element=watch, parameterName=code_block_2.out0)
getParameterValueByName_2 = Element.GetParameterValueByName(element=watch, parameterName=code_block_2.out1)
create = List.Create(getParameterValueByName, getParameterValueByName_2)
transpose = List.Transpose(create)
watch_2 = Watch(transpose)
boolean = BoolSelector(true)
writeToFile = Excel.WriteToFile(filePath=file_path, sheetName=code_block.out0, startRow=code_block.out1, startCol=code_block.out1, data=watch_2, overWrite=boolean)
parameters = Element.Parameters(all_elements_of_category)
watch_3 = Watch(parameters)
fromPath = FileObject(file_path)  # "File.FromPath"
boolean_2 = BoolSelector(true)
readFromFile = Excel.ReadFromFile(file=fromPath, sheetName=code_block.out0, readAsStrings=boolean_2)
transpose_2 = List.Transpose(readFromFile)
code_block_3 = CodeBlock { 0; 1; }
getItemAtIndex = List.GetItemAtIndex(list=transpose_2, index=code_block_3.out0)
code_block_4 = CodeBlock { "Mark"; }
getItemAtIndex_2 = List.GetItemAtIndex(list=transpose_2, index=code_block_3.out1)
setParameterByName = Element.SetParameterByName(element=watch, parameterName=code_block_4, value=getItemAtIndex_2)
